# Grasshopper definition driveway_checker.gh (Grasshopper 1.0.8)
# plug-ins: eleFront

panel = Panel("C:\XY\prototype\260819_Site Plan QC Agent\driveway-checker\driveway_checker.cs")
reflay = ReferenceByLayer(LayerName="_drive", lightweight=False)
srf = Surface(reflay)
crv = Curve(<curve referenced from the Rhino model>)
S = Script(Script=panel, Regulations="dummy", S=srf, C=crv)  # -> Out, Edges, Tag_planes, Tag_texts, Delineation_lines
panel_2 = Panel(S.Out)
preview = CustomPreview(
    Geometry=S.Edges,
    Material={diffuse=RGB(0, 0, 211), emission=RGB(0, 0, 63), shine=0.5, specular=RGB(255, 255, 255), transparency=0})
preview_2 = CustomPreview(
    Geometry=S.Delineation_lines,
    Material={diffuse=RGB(255, 0, 0), emission=RGB(76, 0, 0), shine=0.5, specular=RGB(255, 255, 255), transparency=0})
tag = TextTag3D(Location=S.Tag_planes, Text=S.Tag_texts, Size=3, Colour=RGB(0, 0, 0), Justification=7)
